# Grasshopper definition BSA_CLIMATE CHARTS.gh (Grasshopper 1.0.7)
# plug-ins: Ironbug.LBHB_Legacy, Bifocals

# ---- group: EPW Data
# http://climate.onebuilding.org/WMO_Region_5_Southwest_Pacific/PHL_Philippines/DAV_Davao_Region/PHL_DAV_Davao.987540_TMYx.zip
# Import the link sa URL or
# i plug directly ang File path
local_file_path = FilePath()
panel = Panel("""DAVAO CITY
Bangkerohan""")
panel_2 = Panel("http://climate.onebuilding.org/WMO_Region_5_Southwest_Pacific/PHL_Philippines/DAV_Davao_Region/PHL_DAV_Davao-Bangoy.Intl.AP.987530_TMYx.zip")
panel_3 = Panel("""DAVAO CITY
Airport""")
epw_stat = Ladybug_OpenEPWAndSTATWeatherFiles(weatherFileURL=panel_2)  # -> epwFile, statFile; plug-in component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

# ---- group: Analysis Period
# Amihan
number_slider = Slider(11, range=1..12)
analysisperiod = Ladybug_AnalysisPeriod(fromMonth=number_slider, fromDay=Slider(15, range=1..30), toMonth=Slider(5, range=1..12), toDay=Slider(15, range=1..30))  # -> out, analysisPeriod; plug-in component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

# Habagat
number_slider_2 = Slider(11, range=1..12)
analysisperiod_2 = Ladybug_AnalysisPeriod(
    fromMonth=Slider(5, range=1..12),
    fromDay=Slider(15, range=1..30),
    toMonth=number_slider_2,
    toDay=Slider(15, range=1..30))  # -> out, analysisPeriod; plug-in component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

# Specific Period
number_slider_3 = Slider(1, range=1..12)
analysisperiod_3 = Ladybug_AnalysisPeriod(
    fromMonth=number_slider_3,
    fromDay=Slider(1, range=1..30),
    toMonth=Slider(12, range=1..12),
    toDay=Slider(30, range=1..30))  # -> out, analysisPeriod; plug-in component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

# Specific Day/Hour
number_slider_4 = Slider(3, range=1..12)
number_slider_5 = Slider(22, range=1..30)
analysisperiod_4 = Ladybug_AnalysisPeriod(
    fromMonth=number_slider_4,
    fromDay=number_slider_5,
    fromHour=Slider(1, range=1..24),
    toMonth=number_slider_4,
    toDay=number_slider_5,
    toHour=Slider(24, range=1..24))  # -> out, analysisPeriod; plug-in component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

# ----
ladybug_site = Ladybug_FalseStartToggle(True)
ladybug = Ladybug_Ladybug()  # -> out; plug-in component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
downloadepw = Ladybug_downloadEPWWeatherFile(download=ladybug_site)  # -> Output; plug-in component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

# ---- group: Analysis Period
# Filter para ma pili unsa
# na Analysis period
analysis_period = ValueList({"Amihan": 0, "Habagat": 1, "Specific Period": 2, "Specific Day/Hour": 3}, selected="Amihan")
stream_filter = StreamFilter(
    Gate=analysis_period,
    Stream0=analysisperiod.analysisPeriod,
    Stream1=analysisperiod_2.analysisPeriod,
    Stream2=analysisperiod_3.analysisPeriod,
    Stream3=analysisperiod_4.analysisPeriod)

# ---- group: CLIMATE METRIC
# Please i check ni, mas
# reliable kung mas recent
importepw = Ladybug_ImportEpw(epwFile=epw_stat.epwFile)  # -> Output, latitude, location, dryBulbTemperature, dewPointTemperature, relativeHumidity, windSpeed, windDirection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; plug-in component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
panel_4 = Panel(importepw.location)
cluster = Cluster(list=importepw.modelYear, index="7")
model_period = Panel(cluster)
metric = ValueList({"Air Temperature": 0, "Relative Humidity": 1, "Wind Speed": 2, "Wind Direction": 3, "Direct Normal Radiation": 4, "Diffuse Horizontal Radiation": 5, "Global Horizontal Radiation": 6, "Direct Normal Illuminance": 7, "Diffuse Horizontal Illuminance": 8, "Global Horizontal Illuminance": 9, "Total Sky Cover": 10, "Atmospheric Pressure": 11}, selected="Relative Humidity")
stream_filter_2 = StreamFilter(
    Gate=metric,
    Stream0=importepw.dryBulbTemperature,
    Stream1=importepw.relativeHumidity,
    Stream2=importepw.windSpeed,
    Stream3=importepw.windDirection,
    Stream4=importepw.directNormalRadiation,
    Stream5=importepw.diffuseHorizontalRadiation,
    Stream6=importepw.globalHorizontalRadiation,
    Stream7=importepw.directNormalIlluminance,
    Stream8=importepw.diffuseHorizontalIlluminance,
    Stream9=importepw.globalHorizontalIlluminance,
    Stream10=importepw.totalSkyCover,
    Stream11=importepw.barometricPressure)

# ----
psychchart = Ladybug_PsychrometricChart(dryBulbTemperature=importepw.dryBulbTemperature, relativeHumidity=importepw.relativeHumidity, runIt=Toggle(True))  # -> out, port, totalComfortPercent, totalComfortOrNot, strategyNames, strategyPercentOfTime, strategyOrNot, port_2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; plug-in component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
_3dchart = Ladybug_3DChart(inputData=flatten(stream_filter_2), xScale="0.25", zScale="0")  # -> out, graphMesh, graphCurves, legend, legendBasePts, title, titleBasePts, dataPts, conditionalHOY; plug-in component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

# ==== cluster Cluster
list = ClusterInput()
index = ClusterInput()
split_list = SplitList(List=list, Index=index)  # -> ListA, ListB
sort_list = SortList(Keys=split_list.ListB)  # -> Keys, ValuesValuesA
list_item = ListItem(List=sort_list.Keys, Index=0, Wrap=True)  # -> Item1, Item
construct_domain = ConstructDomain(DomainStart=list_item.Item, DomainEnd=list_item.Item1)  # -> flatten(Domain)
domain = ClusterOutput(construct_domain)
