# Grasshopper definition Ngsuy_solarRadStudy.gh (Grasshopper 1.0.7)

# ----
# massing alternatives
massing3 = Geometry([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])
massing6 = Geometry([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])
massing4 = Geometry([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])
massing5 = Geometry([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])
massing2 = Geometry([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])
# internalized
# geometries
massing1 = Geometry([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])

# ----
# final massing
# final massing geometries
# for detailed solar rad study
finalmassing = Geometry([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])

localshading = Geometry([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])
localshadingoversized = Geometry([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])

openingsforfinalmassing = Geometry([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])
wallsfinalmassing = Geometry([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])
ceilingsfinalmassing = Geometry([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])
floorsfinalmassing = Geometry([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])
roofsfinalmassing = Geometry([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])

# ----
# Site and context geom.
shadingcontext = Geometry([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])
sitegeometry = Geometry(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)

# ----
# use this cluster to find surface normals
shownormal = ShowNormal()

# ----
# 2. Load your *.epw weather file
panel = Panel("http://climate.onebuilding.org/WMO_Region_6_Europe/GRC_Greece/MH_Macedonia_and_Thrace/GRC_MH_Thessaloniki-Makedonia.AP.166220_TMYx.zip")
epw_stat = Ladybug_OpenEPWAndSTATWeatherFiles(weatherFileURL=panel)  # -> epwFile, statFile; plug-in component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
importepw = Ladybug_ImportEpw(epwFile=epw_stat.epwFile)  # -> readMe, latitude, location, dryBulbTemperature, dewPointTemperature, relativeHumidity, windSpeed, windDirection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; plug-in component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

# ----
# north arrow
pt = Point(Point(31.86861749, -39.97042362, 0))
northarrow = Ladybug_North(centerPt=pt)  # -> northSign; plug-in component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
preview = CustomPreview(Geometry=northarrow, Material=ColourSwatch(SwatchColor=RGB(13, 1, 1)))

# ----
# Prep work
# 1. Load LB
ladybug = Ladybug_Ladybug()  # -> Vviiiiiiiiiizzz; plug-in component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

shadingcontext_2 = Geometry(shadingcontext)
sitegeometry_2 = Geometry(sitegeometry)
buildingmassing = Geometry(finalmassing)
shadingsurfaces = Geometry(localshading)
openings = Geometry(openingsforfinalmassing)

hour = Slider(15, range=1..24)
day = Slider(1, range=1..31)
month = Slider(4, range=1..12)

# ----
# 3. Load your site geometry and context
area = Area(Geometry=sitegeometry_2)  # -> Area, Centroid

# ----
# all year
analysisperiod = Ladybug_AnalysisPeriod()  # -> readMe, analysisPeriod; plug-in component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

# ----
# specific hour
python = GhPythonScript(x=hour)  # -> a
# ---------- python: Python ----------
__author__ = "arisv"
__version__ = "2021.10.04"

if x < 24:
    a = x + 1
else:
     a = 1
# ---------- end python ----------
analysisperiod_2 = Ladybug_AnalysisPeriod(fromMonth=month, fromDay=day, fromHour=hour, toMonth=month, toDay=day, toHour=python)  # -> readMe, analysisPeriod; plug-in component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

siteandbuilding = Relay([buildingmassing, sitegeometry_2])
siteandcontext = Relay([sitegeometry_2, shadingcontext_2])

# ----
# heating period
# change these values for your climate
analysisperiod_3 = Ladybug_AnalysisPeriod(fromMonth="10", fromDay="15", fromHour="1", toMonth="3", toDay="15", toHour="24")  # -> readMe, analysisPeriod; plug-in component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

# ----
# cooling period
# change these values for your climate
analysisperiod_4 = Ladybug_AnalysisPeriod(fromMonth="6", fromDay="1", fromHour="1", toMonth="9", toDay="31", toHour="24")  # -> readMe, analysisPeriod; plug-in component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

# ----
# custom period
analysisperiod_5 = Ladybug_AnalysisPeriod(
    fromMonth=Slider(12, range=1..12),
    fromDay=Slider(21, range=1..31),
    fromHour=Slider(1, range=1..24),
    toMonth=Slider(12, range=1..12),
    toDay=Slider(21, range=1..31),
    toHour=Slider(24, range=1..24))  # -> readMe, analysisPeriod; plug-in component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

# ----
# select period or hour of year (HOY) for sunlight hours and solar rad. study
# Do NOT use seasonal or annual periods with high resolution sunlight hours study!
# Prefer a custom period (e.g. a typical day) for each season instead for quick visualization!
# Full solar radiation studies do not suffer from this issue!
list = ValueList({"Annual": 0, "Heating Period": 1, "Cooling Period": 2, "Custom period": 3, "A specific hour": 4}, selected="Cooling Period")
filter = StreamFilter(
    Gate=list,
    Stream0=analysisperiod.analysisPeriod,
    Stream1=analysisperiod_3.analysisPeriod,
    Stream2=analysisperiod_4.analysisPeriod,
    Stream3=analysisperiod_5.analysisPeriod,
    Stream4=analysisperiod_2.analysisPeriod)

# ----
# preview
wires = BrepWireframe(Brep=siteandcontext, Density=-1)
wires_2 = BrepWireframe(Brep=shadingcontext_2, Density=-1)
wires_3 = BrepWireframe(Brep=shadingsurfaces, Density=-1)
wires_4 = BrepWireframe(Brep=openings, Density=-1)
wires_5 = BrepWireframe(Brep=buildingmassing, Density=-1)
preview_2 = CustomPreview(Geometry=wires, Material=ColourSwatch(SwatchColor=RGB(255, 13, 13)))
preview_3 = CustomPreview(Geometry=wires_2, Material=ColourSwatch(SwatchColor=RGB(128, 128, 128)))
preview_4 = CustomPreview(Geometry=wires_3, Material=ColourSwatch(SwatchColor=RGB(0, 255, 98)))
preview_5 = CustomPreview(Geometry=wires_4, Material=ColourSwatch(SwatchColor=RGB(112, 112, 112)))
preview_6 = CustomPreview(Geometry=wires_5, Material=ColourSwatch(SwatchColor=RGB(0, 0, 0)))

panel_2 = Panel("800")  # disabled
panel_3 = Panel("100")  # disabled

# ----
# Preliminary study
# show only some suns per day
showsuneveryhrs = Slider(1, range=1..3)
division = Division(A="24", B=showsuneveryhrs)
range = Range(Domain="24", Steps=division)

# ----
# Detailed solar irradiation study
# 6. set to 'True' to generate an annual cumulative sky
gencumulativesky = BooleanToggle(True)
gencumulativeskymtx = Ladybug_GenCumulativeSkyMtx(epwFile=epw_stat.epwFile, skyDensity=0, useOldRes=True, runIt=gencumulativesky)  # -> readMe, cumulativeSkyMtx; plug-in component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
selectskymtx = Ladybug_selectSkyMtx(cumulativeSkyMtx=gencumulativeskymtx.cumulativeSkyMtx, analysisPeriod=filter, removeDiffuse=False, removeDirect=False)  # -> readMe, selectedSkyMtx; plug-in component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

# ----
# adjust legend bounds and visualization
swatch = ColourSwatch(SwatchColor=RGB(255, 132, 0))  # disabled
swatch_2 = ColourSwatch(SwatchColor=RGB(46, 29, 11))  # disabled
swatch_3 = ColourSwatch(SwatchColor=RGB(255, 251, 0))  # disabled
swatch_4 = ColourSwatch(SwatchColor=RGB(255, 254, 230))  # disabled
panel_4 = Panel("0")  # disabled
legendpar = Ladybug_LegendParameters(lowBound=panel_3, highBound=panel_2, customColors=flatten([swatch_2, swatch, swatch_3, swatch_4]), decimalPlaces=panel_4)  # -> legendPar; disabled; plug-in component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

# ----
# adjust sun path scale to fit site
# and choose daily sun path
number_slider = Slider(0.3, range=0.1..1)  # disabled
changesunpath = BooleanToggle(False)  # disabled

# ----
# visualize the solstices
months = Panel("""6
12""")  # disabled
day_2 = Panel("21")

# ----
# adjust these by taking into account :
# *building programme
# *building thermal mass
# *summer natural ventilation
# think what outside air temp has to be
# in order to make someone use heating
# or cooling in such building.
low_basepoint_temp = Panel("18")
high_basepoint_temp = Panel("26")

number_slider_2 = Slider(0.1, range=0.1..1)  # disabled

# ----
# select 5 for greyscale
panel_5 = Panel("5")  # disabled
panel_6 = Panel("6")  # disabled

number_slider_3 = Slider(2, range=1..10)  # disabled
pt_2 = Point(Point(23.83103882, -165.3503879, 0))  # disabled
gradientlibrary = Ladybug_GradientLibrary(gradIndex=panel_6)  # -> customColors; disabled; plug-in component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
legendpar_2 = Ladybug_LegendParameters(customColors=flatten(gradientlibrary), legendLocation=pt_2, legendScale=number_slider_2, fontSize=number_slider_3)  # -> legendPar; disabled; plug-in component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

# ----
# 5. Sunlight hours
# WARNING: Do not enable/run unless resolution is set to high or  analysis period is set to day or hour. Or you risk crashing!
list_2 = ValueList({"No Local shading": 0, "Local shading": 1}, selected="Local shading")  # disabled
changesunpath_2 = BooleanToggle(False)  # disabled
filter_2 = StreamFilter(Gate=list_2, Stream0=shadingcontext_2, Stream1=[shadingsurfaces, shadingcontext_2])  # disabled
sunpath = Ladybug_SunPath(
    location=importepw.location,
    hour=12,
    day=21,
    month=12,
    timeStep=1,
    analysisPeriod=filter,
    centerPt=area.Centroid,
    sunPathScale=number_slider,
    dailyOrAnnualSunPath=changesunpath_2)  # -> readMe, sunVectors, sunAltitudes, sunAzimuths, port, sunSpheresMesh, sunPathCrvs, compassCrvs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; disabled; plug-in component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
analysisresolution_m = Panel("1")  # disabled
toggle = BooleanToggle(True)  # disabled
toggle_2 = BooleanToggle(True)  # disabled
panel_7 = Panel("0.01")  # disabled
sunlighthoursanalysis = Ladybug_SunlightHoursAnalysis(
    geometry=flatten(siteandbuilding),
    context=flatten(filter_2),
    gridSize=analysisresolution_m,
    disFromBase=panel_7,
    sunVectors=flatten(sunpath.sunVectors),
    timeStep=1,
    legendPar=flatten(legendpar_2),
    parallel=toggle,
    runIt=toggle_2)  # -> readMe, contextMesh, analysisMesh, testPts, testVec, port, sunlightHoursResult, sunlightHoursMesh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; disabled; plug-in component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

hours_in_year = Panel("8760")
series = Series(Start="1", Step=1, Count=hours_in_year)

# ----
# optional:
# if the climate does not have distinct
# heating/cooling periods then you
#  can use conditionals to select hours
# above and below a "comfort range"
# for solar rad: plug the HOY result into selectSkyMtx
# to create a sky with just the hours for
# heating/cooling
# for daylight hours: plug drybulb temp
# directly into annual hourly data,
# then apply a conditional e.g. a<15
# if you want suns for HOYs where
# air temp is lower than 15C
strnum = Ladybug_SeparateData(inputList=flatten(importepw.dryBulbTemperature))  # -> numbers, strings; plug-in component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
larger = LargerThan(FirstNumber=strnum.numbers, SecondNumber=high_basepoint_temp)  # -> LargerThan, OrEqualTo
smaller = SmallerThan(FirstNumber=strnum.numbers, SecondNumber=low_basepoint_temp)  # -> SmallerThan, OrEqualTo
dispatch = Dispatch(List=series, DispatchPattern=smaller.SmallerThan)  # -> ListA, ListB
dispatch_2 = Dispatch(List=series, DispatchPattern=larger.LargerThan)  # -> ListA, ListB

# ----
# 4. Sun Path Visualization (solstices)
sunpath_2 = Ladybug_SunPath(
    location=importepw.location,
    hour=range,
    day=day_2,
    month=months,
    timeStep=1,
    centerPt=area.Centroid,
    sunPathScale=number_slider,
    annualHourlyData=flatten(importepw.globalHorizontalRadiation),
    legendPar=legendpar,
    dailyOrAnnualSunPath=changesunpath)  # -> readMe, sunVectors, sunAltitudes, sunAzimuths, port, sunSpheresMesh, sunPathCrvs, compassCrvs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; disabled; plug-in component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

swatch_5 = ColourSwatch(SwatchColor=RGB(0, 0, 0))  # disabled

swatch_6 = ColourSwatch(SwatchColor=RGB(66, 66, 66))  # disabled
swatch_7 = ColourSwatch(SwatchColor=RGB(250, 255, 194))  # disabled
preview_7 = CustomPreview(Geometry=sunpath.compassCrvs, Material=swatch_6)  # disabled
preview_8 = CustomPreview(Geometry=sunpath.sunPathCrvs, Material=swatch_5)  # disabled

accountforlocalshading = BooleanToggle(True)
list_3 = ValueList({"simulate Massing + site": 0, "simulate only Massing": 1, "simulate only windows": 2}, selected="simulate only windows")

cooling_hoys = Data(dispatch_2.ListA)
heating_hoys = Data(dispatch.ListA)

# ----
# show curves, suns, legend
swatch_8 = ColourSwatch(SwatchColor=RGB(74, 74, 74))
sunspheres = Geometry(sunpath_2.sunSpheresMesh)
preview_9 = CustomPreview(Geometry=[sunpath_2.sunPathCrvs, sunpath_2.compassCrvs], Material=swatch_8)
legend = Geometry(sunpath_2.legend)

# ----
# label suns
number_slider_4 = Slider(4, range=0..10)  # disabled
Z = UnitZ(Factor=number_slider_4)  # disabled
move = Move(Geometry=sunpath_2.sunPositions, Motion=Z)  # -> Geometry, Transform
tag = TextTag(Location=move.Geometry, Text=sunpath_2.sunPositionsInfo, Colour=swatch_8)

# ----
# visualization params.
swatch_9 = ColourSwatch(SwatchColor=RGB(255, 132, 0))
legendpar_3 = Ladybug_LegendParameters(
    customColors=flatten([ColourSwatch(SwatchColor=RGB(18, 11, 3)), swatch_9, ColourSwatch(SwatchColor=RGB(255, 251, 0)), ColourSwatch(SwatchColor=RGB(255, 254, 230))]),
    decimalPlaces="0")  # -> legendPar; plug-in component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

# ----
# 7. visualize sky dome
# Don't forget to select desired period!
number_slider_5 = Slider(0.5, range=0.1..1)
skydome = Ladybug_SkyDome(
    selectedSkyMtx=selectskymtx.selectedSkyMtx,
    centerPoint=area.Centroid,
    scale=number_slider_5,
    legendPar=legendpar_3,
    showTotalOnly=Toggle(True),
    runIt=Toggle(True))  # -> readMe, skyPatchesMesh, baseCrvs, altitudeCrvs, legend, legendBasePts, skyPatchesCenPts, skyPatchesAreas, skyPatchesAsBrep, values; plug-in component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

# ----
# 8. run annual solar irradiation study
selectskymtx_2 = Ladybug_selectSkyMtx(cumulativeSkyMtx=gencumulativeskymtx.cumulativeSkyMtx, removeDiffuse=False, removeDirect=False)  # -> readMe, selectedSkyMtx; plug-in component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
filter_3 = StreamFilter(Gate=list_3, Stream0=siteandbuilding, Stream1=buildingmassing, Stream2=openings)
filter_4 = StreamFilter(Gate=accountforlocalshading, Stream0=shadingcontext_2, Stream1=[shadingsurfaces, shadingcontext_2])
analysis_resolution = Panel("1")
radiationanalysis = Ladybug_RadiationAnalysis(
    geometry=flatten(filter_3),
    context=flatten(filter_4),
    gridSize=analysis_resolution,
    disFromBase="0.01",
    selectedSkyMtx=flatten(selectskymtx_2.selectedSkyMtx),
    legendPar=flatten(legendpar_3),
    parallel=Toggle(True),
    runIt=Toggle(True))  # -> readMe, contextMesh, analysisMesh, testPts, testVec, port, radiationResult, radiationMesh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; plug-in component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

# ----
# Note: Be cautious when using total irradiation as a performance metric!
# 
# Different surfaces have a different role in building energy budget!
# 
# This also depends on seasonal heating/cooling needs.
# Calculating seasonal solar irradiation just for window surfaces is a better metric.
total_radiation_kwh_m2 = Panel(radiationanalysis.totalRadiation)

# ----
# 9. run real time insolation study for custom period.
selectskymtx_3 = Ladybug_selectSkyMtx(cumulativeSkyMtx=gencumulativeskymtx.cumulativeSkyMtx, analysisPeriod=filter, removeDiffuse=False, removeDirect=False)  # -> readMe, selectedSkyMtx; plug-in component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
rtradiationanalysis = Ladybug_RealTimeRadiationAnalysis(selectedSkyMatrix=selectskymtx_3.selectedSkyMtx, intersectionMatrix=radiationanalysis.intersectionMtx)  # -> radiationResult; plug-in component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

legendpar_4 = Ladybug_LegendParameters(
    customColors=flatten([ColourSwatch(SwatchColor=RGB(18, 11, 3)), ColourSwatch(SwatchColor=RGB(255, 132, 0)), ColourSwatch(SwatchColor=RGB(255, 251, 0)), ColourSwatch(SwatchColor=RGB(255, 254, 230))]),
    decimalPlaces="2")  # -> legendPar; plug-in component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
recolormesh = Ladybug_RecolorMesh(
    analysisResult=rtradiationanalysis,
    inputMesh=radiationanalysis.radiationMesh,
    legendPar=legendpar_4,
    analysisTitle="insolation analysis",
    legendTitle="insolation(kWh/m2)")  # -> readMe, newMesh, newLegend, legendBasePt, meshColors, legendColors; plug-in component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

ma = MassAddition(Input=rtradiationanalysis)  # -> Result, PartialResults
total_insolation_kwh_m2 = Panel(ma.Result)

# ==== cluster ShowNormal
pluggeohere = ClusterInput()

# ----
# find surface normals
pluggeohere_2 = Geometry(pluggeohere)
evalsrf = EvaluateSurface(Surface=reparameterize(pluggeohere_2), Point="0.5,0.5")  # -> Point, Normal, UDirection, VDirection, Frame
amp = Amplitude(Vector=evalsrf.Normal, Amplitude="10")
vdisex = VectorDisplayEx(Point=evalsrf.Point, Vector=amp, Colour=RGB(0, 0, 0), Width=2)
