# Grasshopper definition GH_JLAO map.gh (Grasshopper 1.0.7)

# ----
# inputs (location, radius)
panel = Panel("  7° 5'27.43\"N")
dmstodd = Gismo_DMSToDD(dms=panel)  # -> decimalDegree; plug-in component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
dmstodd_2 = Gismo_DMSToDD(dms="125°36'40.63\"E")  # -> decimalDegree; plug-in component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

gismo = Gismo_Gismo(gismoFolder="c:\gismo")  # -> readMe; plug-in component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

# ---- group: location
createlocation = Gismo_CreateLocation(locationName="Davao_Asa ta?", latitude=dmstodd, longitude=dmstodd_2)  # -> location; plug-in component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

# ---- group: radius
panel_2 = Panel("300")

# ---- group: green areas
# 2d shapes
# found parks
osmobjects = Gismo_OSMObjects({"Building", "Commercial building", "Residential building", "Office building", "Office administrative", "Office government", "Post office", "Hospital", "Ambulance station", "Pharmacy"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}, selected="Park")
osmobjects_2 = Gismo_OSMObjects({"Building", "Commercial building", "Residential building", "Office building", "Office administrative", "Office government", "Post office", "Hospital", "Ambulance station", "Pharmacy"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}, selected="Garden")
data = Data([osmobjects, osmobjects_2])
osmkeys = Gismo_OSMKeys(OSMobjectName=data)  # -> readMe, requiredKeys, OSMwebpage; inputs OSMobjectName: list; plug-in component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
osmshapes = Gismo_OSMShapes(
    location=createlocation,
    radius=panel_2,
    shapeType="0",
    requiredKeys=osmkeys.requiredKeys,
    bakeIt=False,
    runIt=Toggle(False))  # -> readMe, shapes, keys, values, port, titleOriginPt, title; inputs radius: Int32, origin: Point3d, shapeType: Int32, requiredKeys: list, onlyRemove_Ids: tree, bakeIt: Boolean, runIt: Boolean; plug-in component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
osmtag = Gismo_OSMTag(OSMobjectName=data)  # -> readMe, requiredTag; inputs OSMobjectName: list, port_3: list; plug-in component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
osmsearch = Gismo_OSMSearch(
    requiredTag=osmtag.requiredTag,
    shapes=osmshapes.shapes,
    keys=osmshapes.keys,
    values=osmshapes.values,
    createFootprints=Toggle(True),
    bakeIt=False,
    runIt=Toggle(False))  # -> readMe, foundShapes, foundKeys, foundValues, foundShapeOrNot, foundObjectNames, port, titleOriginPt, title; inputs requiredTag: tree, shapes: tree of GeometryBase, keys: list, values: tree, threeDeeShapes: tree of GeometryBase, threeDeeValues: tree, createFootprints: Boolean, groundTerrain: Brep, bakeIt: Boolean, runIt: Boolean; plug-in component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
createlegend = Gismo_CreateLegend(
    values=flatten(osmsearch.foundObjectNames),
    analysisGeometry=flatten(osmsearch.foundShapes),
    bakeIt=False,
    runIt=Toggle(False))  # -> readMe, coloredGeometry, title, titleOriginPt, legend, legendPlane; inputs values: list, analysisGeometry: list of GeometryBase, legendBakePar: tree, bakeIt: Boolean, runIt: Boolean; plug-in component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

# ---- group: roads
# found roads
osmobjects_3 = Gismo_OSMObjects({"Building", "Commercial building", "Residential building", "Office building", "Office administrative", "Office government", "Post office", "Hospital", "Ambulance station", "Pharmacy"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}, selected="Road")
data_2 = Data(osmobjects_3)
osmkeys_2 = Gismo_OSMKeys(OSMobjectName=data_2)  # -> readMe, requiredKeys, OSMwebpage; inputs OSMobjectName: list; plug-in component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
# 2d lines (streets, rivers...)
osmshapes_2 = Gismo_OSMShapes(
    location=createlocation,
    radius=panel_2,
    shapeType="1",
    requiredKeys=osmkeys_2.requiredKeys,
    bakeIt=False,
    runIt=Toggle(False))  # -> readMe, shapes, keys, values, port, titleOriginPt, title; inputs radius: Int32, origin: Point3d, shapeType: Int32, requiredKeys: list, onlyRemove_Ids: tree, bakeIt: Boolean, runIt: Boolean; plug-in component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
osmtag_2 = Gismo_OSMTag(OSMobjectName=data_2)  # -> readMe, requiredTag; inputs OSMobjectName: list, port_3: list; plug-in component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
osmsearch_2 = Gismo_OSMSearch(
    requiredTag=osmtag_2.requiredTag,
    shapes=osmshapes_2.shapes,
    keys=osmshapes_2.keys,
    values=osmshapes_2.values,
    createFootprints=False,
    bakeIt=False,
    runIt=Toggle(False))  # -> readMe, foundShapes, foundKeys, foundValues, foundShapeOrNot, foundObjectNames, port, titleOriginPt, title; inputs requiredTag: tree, shapes: tree of GeometryBase, keys: list, values: tree, threeDeeShapes: tree of GeometryBase, threeDeeValues: tree, createFootprints: Boolean, groundTerrain: Brep, bakeIt: Boolean, runIt: Boolean; plug-in component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

# ----
# analyse terrain
#   (hill shading)
# generate terrain
# analyse terrain
#   (flow paths)
toggle = BooleanToggle(True)
terraingenerator = Gismo_TerrainGenerator(location=createlocation, radius=panel_2, type=2, standThickness="40", numOfContours="40", bakeIt=False, runIt=toggle)  # -> readMe, terrain, origin, elevation, elevationContours, title; inputs radius: Int32, source: Int32, type: Int32, origin: Point3d, numOfContours: Int32, legendBakePar: tree, bakeIt: Boolean, runIt: Boolean; plug-in component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
geo = Geometry(terraingenerator.elevationContours)
flowpaths = Gismo_FlowPaths(
    geometry=terraingenerator.terrain,
    numOfInitialPts="5000",
    initialPtsSpread=1,
    stepSize="50",
    flowPathsType=0,
    bakeIt=False,
    runIt=Toggle(False))  # -> readMe, flowPaths, title, titleOrigin; inputs geometry: list, numOfInitialPts: Int32, initialPtsSpread: Int32, flowPathsType: Int32, bakeIt: Boolean, runIt: Boolean; plug-in component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
terrainanalysis = Gismo_TerrainAnalysis(
    analysisType="5",
    terrain=terraingenerator.terrain,
    origin=terraingenerator.origin,
    elevation=terraingenerator.elevation,
    north=0,
    hypsoStrength=50,
    refine=False,
    bakeIt=False,
    runIt=Toggle(False))  # -> readMe, analysedTerrain, values, origin, title, legend, legendPlane; inputs analysisType: Int32, origin: Point3d, context: list, sunVector: Vector3d, refine: Boolean, legendBakePar: tree, bakeIt: Boolean, runIt: Boolean; plug-in component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
preview = CustomPreview(Geometry=flowpaths.flowPaths, Shader=ColourSwatch(SwatchColor=RGB(35, 71, 102)))

# ---- group: buildings
# 2d shapes
# 3d buildings
osmobjects_4 = Gismo_OSMObjects({"Building", "Commercial building", "Residential building", "Office building", "Office administrative", "Office government", "Post office", "Hospital", "Ambulance station", "Pharmacy"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}, selected="Building")
osmkeys_3 = Gismo_OSMKeys(OSMobjectName=osmobjects_4)  # -> readMe, requiredKeys, OSMwebpage; inputs OSMobjectName: list; plug-in component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
osmshapes_3 = Gismo_OSMShapes(
    location=createlocation,
    radius=panel_2,
    shapeType="0",
    requiredKeys=osmkeys_3.requiredKeys,
    bakeIt=False,
    runIt=Toggle(False))  # -> readMe, shapes, keys, values, port, titleOriginPt, title; inputs radius: Int32, origin: Point3d, shapeType: Int32, requiredKeys: list, onlyRemove_Ids: tree, bakeIt: Boolean, runIt: Boolean; plug-in component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
osm3d = Gismo_OSM3D(
    shapes=osmshapes_3.shapes,
    keys=osmshapes_3.keys,
    values=osmshapes_3.values,
    randomHeightRange="10 to 20",
    treeType=2,
    bakeIt=False,
    runIt=Toggle(False))  # -> readMe, threeDeeShapes, threeDeeKeys, threeDeeValues, height; inputs shapes: tree of GeometryBase, keys: list, values: tree, onlyRemove_Ids: tree, treeType: Int32, groundTerrain: Brep, bakeIt: Boolean, runIt: Boolean; plug-in component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
preview_2 = CustomPreview(Geometry=osm3d.threeDeeShapes, Shader=ColourSwatch(SwatchColor=RGB(240, 190, 0)))

# ---- group: trees
# points (trees, bus stops...)
# 3d trees
osmobjects_5 = Gismo_OSMObjects({"Building", "Commercial building", "Residential building", "Office building", "Office administrative", "Office government", "Post office", "Hospital", "Ambulance station", "Pharmacy"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}, selected="Tree")
osmkeys_4 = Gismo_OSMKeys(OSMobjectName=osmobjects_5)  # -> readMe, requiredKeys, OSMwebpage; inputs OSMobjectName: list; plug-in component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
osmshapes_4 = Gismo_OSMShapes(
    location=createlocation,
    radius=panel_2,
    shapeType="2",
    requiredKeys=osmkeys_4.requiredKeys,
    bakeIt=False,
    runIt=Toggle(False))  # -> readMe, shapes, keys, values, port, titleOriginPt, title; inputs radius: Int32, origin: Point3d, shapeType: Int32, requiredKeys: list, onlyRemove_Ids: tree, bakeIt: Boolean, runIt: Boolean; plug-in component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
osm3d_2 = Gismo_OSM3D(
    shapes=osmshapes_4.shapes,
    keys=osmshapes_4.keys,
    values=osmshapes_4.values,
    randomHeightRange="4 to 10",
    treeType=2,
    bakeIt=False,
    runIt=Toggle(True))  # -> readMe, threeDeeShapes, threeDeeKeys, threeDeeValues, height; inputs shapes: tree of GeometryBase, keys: list, values: tree, onlyRemove_Ids: tree, treeType: Int32, groundTerrain: Brep, bakeIt: Boolean, runIt: Boolean; plug-in component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
preview_3 = CustomPreview(Geometry=osm3d_2.threeDeeShapes, Shader=ColourSwatch(SwatchColor=RGB(0, 102, 0)))

# ----
# 3d roads
osm3droad = Gismo_OSM3DRoad(shapes=flatten(osmsearch_2.foundShapes), roadWidth="6", bakeIt=False, runIt=Toggle(False))  # -> readMe, threeDeeRoads; inputs shapes: list of GeometryBase, groundTerrain: Brep, bakeIt: Boolean, runIt: Boolean; plug-in component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

list = ValueList({"parapet wall_range": "0.5 to 1.5", "pitched roof_range": "20 to 35"}, selected="pitched roof_range")
list_2 = ValueList({"parapet wall": 0, "pitched roof": 1}, selected="pitched roof")
# 3d roof
osm3droof = Gismo_OSM3DRoof(
    threeDeeShapes=osm3d.threeDeeShapes,
    threeDeeKeys=osm3d.threeDeeKeys,
    threeDeeValues=osm3d.threeDeeValues,
    randomRange=list,
    roofType=list_2,
    bakeIt=False,
    runIt=Toggle(False))  # -> readMe, threeDeeRoof, threeDeeRoofKeys, threeDeeRoofValues, angleOrHeight; inputs threeDeeShapes: tree of GeometryBase, threeDeeKeys: list, threeDeeValues: tree, roofType: Int32, bakeIt: Boolean, runIt: Boolean; plug-in component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
