# Grasshopper definition S03_01_Canopy_RHINO.INSIDE.gh (Grasshopper 1.0.7)
# plug-ins: Rhino.Inside for Autodesk Revit, Bifocals

component_families_picker = ComponentFamiliesPicker(<component families picker referenced from the Revit model>, SearchPattern="UniversalBeam")
built_in_categories = BuiltInCategories(LayoutLevel=2)
crv = Curve([<curve referenced from the Rhino model> x2])
crv_2 = Curve([<curve referenced from the Rhino model> x2])
divide = DivideCurve(Curve=crv, Count=40, Kinks=False)  # -> Points, Tangents, Parameters
divide_2 = DivideCurve(Curve=crv_2, Count=40, Kinks=False)  # -> Points, Tangents, Parameters
family_name_here = ElementTypePicker()
element_type_picker = ElementTypePicker(
    component_families_picker,
    {"SFR_Stl_UniversalBeam : 254x102x28UB": "2689a2b6-5270-4faf-8ee6-9a716cdc7e45-731aaea6-15d2-4722-8466-f95624491340-00060bed", "SFR_Stl_UniversalBeam : 305x165x40UB": "2689a2b6-5270-4faf-8ee6-9a716cdc7e45-731aaea6-15d2-4722-8466-f95624491340-00060beb", "SFR_Stl_UniversalBeam : 356x171x51UB": "2689a2b6-5270-4faf-8ee6-9a716cdc7e45-731aaea6-15d2-4722-8466-f95624491340-00060bef", "SFR_Stl_UniversalBeam : 406x178x60UB": "2689a2b6-5270-4faf-8ee6-9a716cdc7e45-731aaea6-15d2-4722-8466-f95624491340-00060bf1"}, selected="SFR_Stl_UniversalBeam : 254x102x28UB")
type = Type(
    <familysymbol referenced from the Revit model>,
    SelectedBuiltInCategory="autodesk.revit.category.family:structuralFraming")
flip = FlipMatrix(Data=divide.Points)
flip_2 = FlipMatrix(Data=divide_2.Points)
pline = PolyLine(Vertices=flip, Closed=False)
pline_2 = PolyLine(Vertices=flip_2, Closed=False)
levels_picker = LevelsPicker(<levels picker referenced from the Revit model>)
explode = Explode(Curve=pline, Recursive=True)  # -> flatten(Segments), Vertices
explode_2 = Explode(Curve=pline_2, Recursive=True)  # -> flatten(Segments), Vertices
merge = Merge(Data1=pline, Data2=pline_2)
cp = ControlPoints(Curve=explode.Segments)  # -> flatten(Points), Weights, Knots
cp_2 = ControlPoints(Curve=explode_2.Segments)  # -> flatten(Points), Weights, Knots
level = Level()
query_types = QueryTypes()
curve = Curve(<curve referenced from the Rhino model>)
merge_2 = Merge(Data1=cp.Points, Data2=cp_2.Points)
pt = Point(merge_2)
txt = Text(pt)
panel = Panel(query_types)
rep = ReplaceText(Text=txt, Find="{", RecursiveReplace=False)
trigger = Trigger(Interval=-1000, TimerInterval=1000, Target=add_beam)
rep_2 = ReplaceText(Text=rep, Find="}", RecursiveReplace=False)  # -> simplify(Result)
add_beam = AddBeam(Curve=merge, Type=element_type_picker, Level=levels_picker, TrackingMode=2)
branch = TreeBranch(Tree=divide.Parameters, Path="0;1", MaintainPaths=True)
item = ListItem(List=crv, Index="1", Wrap=True)
list_length = ListLength(List=add_beam)
panel_2 = Panel(rep_2)
pframe = PerpFrame(Curve=item, Parameter=branch)
division = Division(A=list_length, B="2")
deplane = DeconstructPlane(Plane=pframe)  # -> Origin, XAxis, YAxis, ZAxis
split_list = SplitList(List=add_beam, Index=division)  # -> ListA, ListB
xz = XZPlane(Origin=Point(0, 0, 0))
vdis = VectorDisplay(Anchor=deplane.Origin, Vector=deplane.XAxis)
Z = UnitZ(Factor=1)
type_2 = Type()
query_element_parameters = QueryElementParameters(Element=split_list.ListA, Name="Cross-Section Rotation")
angle = Angle(VectorA=Z, VectorB=deplane.XAxis, Plane=xz)  # -> Angle, Reflex
deg = Degrees(Radians=angle.Angle)
panel_3 = Panel(deg)
panel_4 = Panel(query_element_parameters)
element_parameter = ElementParameter(Element=flatten(split_list.ListA), Parameter=flatten(query_element_parameters), Value=angle.Angle)  # -> Element, Value
boolean_toggle = BooleanToggle(True)
panel_5 = Panel(element_parameter.Value)
